% Simulink data dictionary dictionary_axon.sldd

axon_command = Simulink.Bus()
  CMD: uint8[12 1]
  SZE: uint8[12 3]
  PYD: uint8[12 10]

axon_CMD = Simulink.Parameter(struct(CMD=uint8(repmat(0, 12, 1)), SZE=uint8(repmat(0, 12, 3)), PYD=uint8(repmat(0, 12, 10))), StorageClass="ExportedGlobal", DataType="Bus: axon_command")  % Default value for axon_command
len_ctx_tx_CMD = 168

axon_stream = Simulink.Bus()
  SZE: uint8[3 3]
  PYD: uint8[3 10]

axon_STM = Simulink.Parameter(struct(SZE=uint8(repmat(0, 3, 3)), PYD=uint8(repmat(0, 3, 10))), StorageClass="ExportedGlobal", DataType="Bus: axon_stream")  % Default value for axon_stream
len_ctx_tx_STM = 39